% Simulink data dictionary motorData.sldd

J = Simulink.Parameter(1.66409e-05, DataType="double", Min=1.0e-12, Max=1000)
L = Simulink.Parameter(3.744049e-05, DataType="double", Min=1.0e-12, Max=1000)
R = Simulink.Parameter(3.402602, DataType="double", Min=1.0e-12, Max=1000)
Vbat = Simulink.Parameter(22, DataType="double", Min=1.0e-12, Max=1000)
Km = Simulink.Parameter(0.01619559, DataType="double", Min=1.0e-12, Max=1000)
bv = Simulink.Parameter(0.0001254584, DataType="double", Min=1.0e-12, Max=1000)